vi "MSpot Spectrum Calibration Subroutine.gvi"   [LabVIEW NXG 5.0.0]
inputs:
  "Error In": error
  "Stand Alone?": bool
  "Calibration Operation Control": "Calibration Operation Control.gtype" = "Check Calibration"
  "Instrument Coms Info In": "Instrument Coms Info.gtype"
  "Rainbow Sweep Param Selector": "Rainbow Sweep Param Selector.gtype" = {0, 1100, 300, 1, 1, 0}
  "MSpot Spectrum Calibration Parameters": "MSpot Spectrum Calibration Parameters.gtype" = {"Min Position (mm)"=0, "Max Position (mm)"=10, "Position step size (mm)"=0.1, "Manual Spectra?"=FALSE}
  "Debugging Cluster In": "Debugging Cluster.gtype"
outputs:
  "Error Out": error
  "Instrument Coms Info Out": "Instrument Coms Info.gtype"
  "Debugging Cluster Out": "Debugging Cluster.gtype"
  "Full Beam Multispectral Data Array": "Full MSpot Multispectral Data.gtype"[]
types:
  T1 = cluster{"Element 1": "VISA Instr", "Element 2": string}
  "Arduino Detection cluster control.gtype" = cluster{"XZ Stage Arduino Address": "VISA Instr", "XZ Stage Arduino Detected?": bool, "Multiplexer Arduino Detected?": bool, "Multiplexer Arduino Address": "VISA Instr", "Arduinos List": T1[], "XZ Stage Log": string, "Multiplexer Log": string}
  "Thorlabs Motors Serial Number In.gtype" = cluster{"Thorlabs Blue Motor": string, "Thorlabs Red Motor": string, "Blue Motor Homed?": bool, "Red Motor Homed?": bool}
  "Instrument Coms Info.gtype" = cluster{"Arduino Coms Info": "Arduino Detection cluster control.gtype", "Photodetector Names": string[], "Keythley Address": "VISA Instr", "Photodetector Detected?": bool, "Thorlabs Motors Detected?": bool, "Keithley Detected?": bool, "Thorlabs Motors Serial Number": "Thorlabs Motors Serial Number In.gtype", "Photodetector IVI session": "Ivi IviDefault"}
  "Raibow Sweep Selector.gtype" = enum{"Red Sweep", "Blue Sweep", "Full Sweep Red First", "Full Sweep Blue First"}
  "Rainbow Sweep Type Selector.gtype" = cluster{"Red Sweep Mode": enum{"Red Sweep Closing", "Red Sweep Opening"}, "Blue Sweep Mode": enum{"Blue Sweep Opening", "Blue Sweep Closing"}}
  "Rainbow Sweep Param Selector.gtype" = cluster{"Raibow Sweep Selector": "Raibow Sweep Selector.gtype", "Max Wavelength (nm)": f64, "Min Wavelength (nm)": f64, "Wavelength Step (nm)": f64, "Rainbow Sweep Types": "Rainbow Sweep Type Selector.gtype"}
  "MSpot Spectrum Data.gtype" = cluster{"M Spot Spectrum": cluster{"Wavelength": f64[], "Counts": f64[]}, "Blue Motor Position (mm)": f64, "Red Motor Position (mm)": f64}
  "Rainbow Sweep Types.gtype" = enum{"Red Sweep Closing", "Red Sweep Opening", "Blue Sweep Closing", "Blue Sweep Opening"}
  "Full MSpot Multispectral Data.gtype" = cluster{"MSpot Spectrum Data Array": "MSpot Spectrum Data.gtype"[], "Rainbow Sweep Types": "Rainbow Sweep Types.gtype"}
  "Insturment Debugging Cluster.gtype" = cluster{"Keithley": bool, "Arduinos": bool, "Thorlabs Motors": bool, "Photodetector": bool}
  "Debugging Cluster.gtype" = cluster{"Debugging mode?": bool, "Initialize App": bool, "Insturment Debugging": "Insturment Debugging Cluster.gtype"}
  "Calibration Operation Control.gtype" = enum{"Check Calibration", "Load Calibration", "New Calibration"}
  "MSpot Spectrum Calibration Parameters.gtype" = cluster{"Min Position (mm)": f64, "Max Position (mm)": f64, "Position step size (mm)": f64, "Manual Spectra?": bool}
uses:
  Rainbow Measurement Setup::Main Functions::Instruction Queue::Current State::FGV Current State.gvi
  Rainbow Measurement Setup::Side Functions::Instrument Control::Debug Cluster Instrument Extractor.gvi
  Rainbow Measurement Setup::Main Functions::One Time Calibrations::Beam Power Density::Specific Detect Instruments Subroutine.gvi
  Rainbow Measurement Setup::Side Functions::Instrument Control::Thorlabs Motors::Movement::KCube Move to 0 or Home.gvi
  Rainbow Measurement Setup::Side Functions::Instrument Control::Arduino::XZ Stage Arduino::XZ Stage Initialize And Home.gvi
  Rainbow Measurement Setup::Side Functions::Instrument Control::Photodetector::Photodetector Initialize.gvi
  Rainbow Measurement Setup::Main Functions::One Time Calibrations::MSpot Spectrum::MSpot Spectrum Rainbow Sweep Subroutine.gvi
  Rainbow Measurement Setup::Side Functions::Instrument Control::Photodetector::Photodetector Close Coms.gvi
  Rainbow Measurement Setup::Side Functions::Instrument Control::Arduino::XZ Stage Arduino::XZ Stage Close Coms.gvi
  Rainbow Measurement Setup::Main Functions::One Time Calibrations::MSpot Spectrum::File Handling::MSpot Spectra file handling.gvi
  Rainbow Measurement Setup::Main Functions::One Time Calibrations::MSpot Spectrum::File Handling::MSpot Load Prompt.gvi
  Rainbow Measurement Setup::Main Functions::One Time Calibrations::MSpot Spectrum::MSpot Spectrum Visualizer.gvi
  Rainbow Measurement Setup::Main Functions::One Time Calibrations::MSpot Spectrum::File Handling::MSpot Calibration Save Graphs Prompt.gvi
  Rainbow Measurement Setup::Side Functions::Global Abort::FGV Global Abort.gvi
diagram:
  # This subVI takes a full spectrum for each guillotine motor position and then changes the guillotine position and continues on taking spectra.
  # After all the spectra have been taken we are presented with the results to determine the dividing wavelength for each position and then we can
  # write down the dividing wavelength file.
  # Falta comunicar amb el flame :') DRAMA
  case ($"Error In") {
    frame Error, Default {
      w1 = $"Error In"
      w2 = default
      w3 = $"Instrument Coms Info In"
      w4 = $"Debugging Cluster In"
    }
    frame No Error {
      call "FGV Current State.gvi"(Current State Instructions="Set Current State and Substate", Current State="MSpot Spectrum Calibration", Current Substate="", Error In=$"Error In") -> (Error Out=w5)
      s1 = w5  # shift register
      s2 = "Start App"  # shift register
      s3 = $"Instrument Coms Info In"  # shift register
      s4 = uninitialised  # shift register
      s5 = $"Debugging Cluster In"  # shift register
      while {
        case (s2) {
          frame "Start App", Default {
            Is Equal(x="Check Calibration", y=$"Calibration Operation Control") -> w12
            Is Equal(x="Load Calibration", y=$"Calibration Operation Control") -> w13
            Logical Or(w12, w13) -> w14
            Select(s=$"Stand Alone?", t="Detect Instruments", f="Initialize Instruments") -> w15
            Select(s=w14, t="Load Calibration", f=w15) -> w6
            call "FGV Current State.gvi"(Current State Instructions="Set Current Substate", Current Substate="Starting MSpot Calibration", Error In=s1) -> (Error Out=w7)
            w8 = s3
            w9 = s4
            w10 = default
            w11 = s5
          }
          frame "Detect Instruments" {
            call "FGV Current State.gvi"(Current State Instructions="Set Current Substate", Current Substate="Detecting Instruments", Error In=s1) -> (Error Out=w16)
            call "Debug Cluster Instrument Extractor.gvi"(Debugging Cluster In=s5, Error In=w16) -> (Debuging Cluster Out=w11, Instruments to Detect=w17, Error Out=w18)
            call "Specific Detect Instruments Subroutine.gvi"(Instrument Coms Info In=s3, Error In=w18, Instruments To Detect Array=w17, Stand Alone?=$"Stand Alone?") -> (Instrument Coms Info Out=w8, Error Out=w7)
            w6 = "Initialize Instruments"
            w9 = s4
            w10 = default
          }
          frame "Initialize Instruments" {
            call "FGV Current State.gvi"(Current State Instructions="Set Current Substate", Current Substate="Initializing Instruments", Error In=s1) -> (Error Out=w19)
            call "KCube Move to 0 or Home.gvi"(Instrument Coms Info In=s3, Debugging Cluster In=s5, Error In=w19) -> (Instrument Coms Info Out=w20, Debugging Cluster Out=w21, Error Out=w22)
            call "XZ Stage Initialize And Home.gvi"(Instrument Coms Info In=w20, Debugging Cluster In=w21, Error In=w22) -> (Instrument Coms Info Out=w23, Debugging Cluster Out=w24, Error Out=w25)
            call "Photodetector Initialize.gvi"(Instrument Coms Info In=w23, Debugging Cluster In=w24, Error In=w25) -> (Instrument Coms Info Out=w8, Debugging Cluster Out=w11, Error Out=w7)
            w6 = "Rainbow Sweep"
            w9 = s4
            w10 = default
          }
          frame "Rainbow Sweep" {
            call "FGV Current State.gvi"(Current State Instructions="Set Current Substate", Current Substate="Acquiring Spectra", Error In=s1) -> (Error Out=w26)
            call "MSpot Spectrum Rainbow Sweep Subroutine.gvi"(Instrument Coms Info In=s3, MSpot Spectrum Calibration Parameters=$"MSpot Spectrum Calibration Parameters", Rainbow Sweep Param Selector=$"Rainbow Sweep Param Selector", Debugging Cluster In=s5, Error In=w26) -> (Instrument Coms Info Out=w8, Full MSpot Multispectral Data Array=w9, Debugging Cluster Out=w11, Error Out=w7)
            w6 = "Close Coms"
            w10 = default
          }
          frame "Close Coms" {
            call "FGV Current State.gvi"(Current State Instructions="Set Current Substate", Current Substate="Closing Coms", Error In=s1) -> (Error Out=w27)
            call "Photodetector Close Coms.gvi"(Instrument Coms Info In=s3, Debugging Cluster In=s5, Error In=w27) -> (Instrument Coms Info Out=w28, Debugging Cluster Out=w11, Error Out=w29)
            call "XZ Stage Close Coms.gvi"(Instrument Coms Info In=w28, Error In=w29) -> (Instrument Coms Info Out=w8, Error Out=w7)
            w6 = "Check Graphs"
            w9 = s4
            w10 = default
          }
          frame "Load Calibration" {
            call "FGV Current State.gvi"(Current State Instructions="Set Current Substate", Current Substate="Loading Calibration", Error In=s1) -> (Error Out=w30)
            call "MSpot Spectra file handling.gvi"(Full MSpot Multispectral Data Array In=s4, Modify File Operation="Load TXT", Error In=w30) -> (Full MSpot Multispectral Data Array Out=w9, Found Any File?=w31, Error Out=w32)
            call "MSpot Load Prompt.gvi"(Found Any File?=w31, Stand Alone=$"Stand Alone?", Error In=w32) -> (Desired State=w6, Error Out=w7)
            w8 = s3
            w10 = default
            w11 = s5
          }
          frame "Check Graphs" {
            call "FGV Current State.gvi"(Current State Instructions="Set Current Substate", Current Substate="Checking Graphs", Error In=s1) -> (Error Out=w33)
            call "MSpot Spectrum Visualizer.gvi"(Full MSpot Multispectral Data Array=s4, Error In=w33) -> (Error Out=w34)
            call "MSpot Calibration Save Graphs Prompt.gvi"(Calibration Operatino Control=$"Calibration Operation Control", Error In=w34) -> (Selected State=w6, Error Out=w7)
            w8 = s3
            w9 = s4
            w10 = default
            w11 = s5
          }
          frame "Save Graphs" {
            call "FGV Current State.gvi"(Current State Instructions="Set Current Substate", Current Substate="Saving Graphs", Error In=s1) -> (Error Out=w35)
            call "MSpot Spectra file handling.gvi"(Full MSpot Multispectral Data Array In=s4, Modify File Operation="Save TXT", Error In=w35) -> (Full MSpot Multispectral Data Array Out=w9, Error Out=w7)
            w6 = "Stop App"
            w8 = s3
            w10 = default
            w11 = s5
          }
          frame "Stop App" {
            call "FGV Current State.gvi"(Current State Instructions="Set Current Substate", Current Substate="Finishing MSpot Calibration", Error In=s1) -> (Error Out=w7)
            w6 = "Start App"
            w8 = s3
            w9 = s4
            w10 = TRUE
            w11 = s5
          }
        }
        call "FGV Global Abort.gvi"(Global Abort Instructions="Read Current State", Error In=w7) -> (Local Abort Out=w36, Global Abort Out=w37, Error Out=w38)
        Logical Or(w36, w37, w10) -> w39
        next s1 = w38
        next s2 = w6
        next s3 = w8
        next s4 = w9
        next s5 = w11
        stop if w39
      }
      w1 = s1
      w2 = s4
      w3 = s3
      w4 = s5
    }
  }
  $"Debugging Cluster Out" <- w4
  $"Error Out" <- w1
  $"Full Beam Multispectral Data Array" <- w2
  $"Instrument Coms Info Out" <- w3
