vi "MSpot Spectrum Rainbow Sweep Subroutine.gvi"   [LabVIEW NXG 5.0.0]
inputs:
  "Instrument Coms Info In": "Instrument Coms Info.gtype"
  "Beam Spectrum Calibration Parameters": "Measuring Spot Spectrum Calibration Parameters.gtype"
  "Rainbow Sweep Param Selector": "Rainbow Sweep Param Selector.gtype" = {0, 1100, 300, 1, 1, 0}
  "Error In": error
outputs:
  "Instrument Coms Info Out": "Instrument Coms Info.gtype"
  "Full Beam Multispectral Data Array": "Full Measuring Spot Multispectral Data.gtype"[]
  "Error Out": error
types:
  "Raibow Sweep Selector.gtype" = enum{"Red Sweep", "Blue Sweep", "Full Sweep Red First", "Full Sweep Blue First"}
  "Rainbow Sweep Type Selector.gtype" = cluster{"Red Sweep Mode": enum{"Red Sweep Closing", "Red Sweep Opening"}, "Blue Sweep Mode": enum{"Blue Sweep Opening", "Blue Sweep Closing"}}
  "Rainbow Sweep Param Selector.gtype" = cluster{"Raibow Sweep Selector": "Raibow Sweep Selector.gtype", "Max Wavelength (nm)": f64, "Min Wavelength (nm)": f64, "Wavelength Step (nm)": f64, "Rainbow Sweep Types": "Rainbow Sweep Type Selector.gtype"}
  "Measuring Spot Spectrum Calibration Parameters.gtype" = cluster{"Min Position (mm)": f64, "Max Position (mm)": f64, "Position step size (mm)": f64}
  "Measuring Spot Spectrum Data.gtype" = cluster{"Beam Spectrum": cluster{"Wavelength": f64[], "Counts": f64[]}, "Blue Motor Position (mm)": f64, "Red Motor Position (mm)": f64}
  "Rainbow Sweep Types.gtype" = enum{"Red Sweep Closing", "Red Sweep Opening", "Blue Sweep Closing", "Blue Sweep Opening"}
  "Full Measuring Spot Multispectral Data.gtype" = cluster{"Beam Spectrum Data Array": "Measuring Spot Spectrum Data.gtype"[], "Rainbow Sweep Types": "Rainbow Sweep Types.gtype"}
  T1 = cluster{"Element 1": "VISA Instr", "Element 2": string}
  "Arduino Detection cluster control.gtype" = cluster{"XZ Stage Arduino Address": "VISA Instr", "XZ Stage Arduino Detected?": bool, "Multiplexer Arduino Detected?": bool, "Multiplexer Arduino Address": "VISA Instr", "Arduinos List": T1[], "XZ Stage Log": string, "Multiplexer Log": string}
  "Thorlabs Motors Serial Number In.gtype" = cluster{"Thorlabs Blue Motor": string, "Thorlabs Red Motor": string, "Blue Motor Homed?": bool, "Red Motor Homed?": bool}
  "Instrument Coms Info.gtype" = cluster{"Arduino Coms Info": "Arduino Detection cluster control.gtype", "Photodetector Names": string[], "Keythley Address": "VISA Instr", "Photodetector Detected?": bool, "Thorlabs Motors Detected?": bool, "Keithley Detected?": bool, "Thorlabs Motors Serial Number": "Thorlabs Motors Serial Number In.gtype", "Photodetector IVI session": "Ivi IviDefault"}
uses:
  Rainbow Measurement Setup::Side Functions::Rainbow Sweep::Rainbow Sweep Type Extractor.gvi
  NXG_KCube_DC_Servo_Control::Utilities::Initialize Motor and Home.gvi
  NXG_KCube_DC_Servo_Control::Utilities::Move To Position.gvi
  Rainbow Measurement Setup::Main Functions::One Time Calibrations::Measuring Spot Spectrum::Random Data Generator.gvi
  NXG_KCube_DC_Servo_Control::Utilities::Disconnect Motor.gvi
diagram:
  # This SubVI Performs a scan of the spectrum of the beam (STILL FLAME CONNECTION MISSING) and then moves the blade motors to perform a full scan of the spectrum with respect to position.
  case ($"Error In") {
    frame Error, Default {
      w1 = default
      w2 = $"Error In"
      w3 = $"Instrument Coms Info In"
    }
    frame No Error {
      Property Node(instance in=$"Beam Spectrum Calibration Parameters") -> ("Min Position (mm)"=w4, "Max Position (mm)"=w5, "Position step size (mm)"=w6)
      call "Rainbow Sweep Type Extractor.gvi"(Rainbow Sweep Parameters=$"Rainbow Sweep Param Selector", Error In=$"Error In") -> (Rainbow Sweep Array=w7, Error Out=w8)
      Subtract(x=w5, y=w4) -> w9
      Divide(x=w9, y=w6) -> w10
      Increment(x=w10) -> w11
      # w12: Number of Steps
      To Signed 32 Bit Integer(number=w11) -> w12
      s1 = "Full Measuring Spot Multispectral Data.gtype"[] []  # shift register
      s2 = w8  # shift register
      s3 = $"Instrument Coms Info In"  # shift register
      for (iteration -> i1) {
        w13 = each element of w7
        Array Index(array=s1) -> (out0[i1]=w14)
        case (w13) {
          frame "Red Sweep Opening", Default {
            Property Node(instance in=s3) -> ("Thorlabs Motors Serial Number:Thorlabs Blue Motor"=w18, "Thorlabs Motors Serial Number:Blue Motor Homed?"=w19, instance out=w20)
            call "Initialize Motor and Home.gvi"(Current Motor Serial nº In=w18, Homed? In=w19, Error In=s2) -> (Current Motor Serial nº Out=w21, Homed? Out=w22, Error Out=w23)
            Property Node(instance in=w20, "Thorlabs Motors Serial Number:Blue Motor Homed?"=w22) -> (instance out=w15)
            s4 = w21  # shift register
            s5 = w23  # shift register
            s6 = "Measuring Spot Spectrum Data.gtype"[] []  # shift register
            for (N = w12) (iteration -> i2) {
              To Double Precision Float(number=i2) -> w24
              Multiply(w6, w24) -> w25
              Subtract(x=w5, y=w25) -> w26
              call "Move To Position.gvi"(Motor Serial Number In=s4, Position to move in mm=w26, Error In=s5) -> (Current Motor Serial nº=w27, Error Out=w28)
              call "Random Data Generator.gvi"() -> (Beam Spectrum=w29)
              Property Node(instance in="Measuring Spot Spectrum Data.gtype" {all zero or empty}, "Beam Spectrum"=w29, "Blue Motor Position (mm)"=w26, "Red Motor Position (mm)"=0) -> (instance out=w30)
              Insert Into Array(inArray=s6, index0=i2, new=w30) -> w31
              next s4 = w27
              next s5 = w28
              next s6 = w31
            }
            call "Disconnect Motor.gvi"(Motor Serial nº=s4, Error In=s5) -> (Error Out=w16)
            Property Node(instance in=w14, "Rainbow Sweep Types"=w13, "Beam Spectrum Data Array"=s6) -> (instance out=w17)
          }
          frame "Red Sweep Closing" {
            Property Node(instance in=s3) -> ("Thorlabs Motors Serial Number:Thorlabs Blue Motor"=w32, "Thorlabs Motors Serial Number:Blue Motor Homed?"=w33, instance out=w34)
            call "Initialize Motor and Home.gvi"(Current Motor Serial nº In=w32, Homed? In=w33, Error In=s2) -> (Current Motor Serial nº Out=w35, Homed? Out=w36, Error Out=w37)
            Property Node(instance in=w34, "Thorlabs Motors Serial Number:Blue Motor Homed?"=w36) -> (instance out=w15)
            s7 = w35  # shift register
            s8 = w37  # shift register
            s9 = "Measuring Spot Spectrum Data.gtype"[] []  # shift register
            for (N = w12) (iteration -> i3) (after w5) {
              To Double Precision Float(number=i3) -> w38
              Multiply(w6, w38) -> w39
              Add(w4, w39) -> w40
              call "Move To Position.gvi"(Motor Serial Number In=s7, Position to move in mm=w40, Error In=s8) -> (Current Motor Serial nº=w41, Error Out=w42)
              w43 = cluster{"Wavelength": f64[], "Counts": f64[]} {"Wavelength"=[2, 3, 4], "Counts"=[5, 6, 7]}
              Property Node(instance in="Measuring Spot Spectrum Data.gtype" {all zero or empty}, "Beam Spectrum"=w43, "Blue Motor Position (mm)"=w40, "Red Motor Position (mm)"=0) -> (instance out=w44)
              Insert Into Array(inArray=s9, index0=i3, new=w44) -> w45
              next s7 = w41
              next s8 = w42
              next s9 = w45
            }
            call "Disconnect Motor.gvi"(Motor Serial nº=s7, Error In=s8) -> (Error Out=w16)
            Property Node(instance in=w14, "Rainbow Sweep Types"=w13, "Beam Spectrum Data Array"=s9) -> (instance out=w17)
          }
          frame "Blue Sweep Closing" {
            Property Node(instance in=s3) -> ("Thorlabs Motors Serial Number:Thorlabs Red Motor"=w46, "Thorlabs Motors Serial Number:Red Motor Homed?"=w47, instance out=w48)
            call "Initialize Motor and Home.gvi"(Current Motor Serial nº In=w46, Homed? In=w47, Error In=s2) -> (Current Motor Serial nº Out=w49, Homed? Out=w50, Error Out=w51)
            Property Node(instance in=w48, "Thorlabs Motors Serial Number:Red Motor Homed?"=w50) -> (instance out=w15)
            s10 = w49  # shift register
            s11 = w51  # shift register
            s12 = "Measuring Spot Spectrum Data.gtype"[] []  # shift register
            for (N = w12) (iteration -> i4) (after w5) {
              To Double Precision Float(number=i4) -> w52
              Multiply(w6, w52) -> w53
              Add(w4, w53) -> w54
              call "Move To Position.gvi"(Motor Serial Number In=s10, Position to move in mm=w54, Error In=s11) -> (Current Motor Serial nº=w55, Error Out=w56)
              w57 = cluster{"Wavelength": f64[], "Counts": f64[]} {"Wavelength"=[2, 3, 4], "Counts"=[5, 6, 7]}
              Property Node(instance in="Measuring Spot Spectrum Data.gtype" {all zero or empty}, "Beam Spectrum"=w57, "Red Motor Position (mm)"=w54, "Blue Motor Position (mm)"=0) -> (instance out=w58)
              Insert Into Array(inArray=s12, index0=i4, new=w58) -> w59
              next s10 = w55
              next s11 = w56
              next s12 = w59
            }
            call "Disconnect Motor.gvi"(Motor Serial nº=s10, Error In=s11) -> (Error Out=w16)
            Property Node(instance in=w14, "Rainbow Sweep Types"=w13, "Beam Spectrum Data Array"=s12) -> (instance out=w17)
          }
          frame "Blue Sweep Opening" {
            Property Node(instance in=s3) -> ("Thorlabs Motors Serial Number:Thorlabs Red Motor"=w60, "Thorlabs Motors Serial Number:Red Motor Homed?"=w61, instance out=w62)
            call "Initialize Motor and Home.gvi"(Current Motor Serial nº In=w60, Homed? In=w61, Error In=s2) -> (Current Motor Serial nº Out=w63, Homed? Out=w64, Error Out=w65)
            Property Node(instance in=w62, "Thorlabs Motors Serial Number:Red Motor Homed?"=w64) -> (instance out=w15)
            s13 = w63  # shift register
            s14 = w65  # shift register
            s15 = "Measuring Spot Spectrum Data.gtype"[] []  # shift register
            for (N = w12) (iteration -> i5) (after w4) {
              To Double Precision Float(number=i5) -> w66
              Multiply(w6, w66) -> w67
              Subtract(x=w5, y=w67) -> w68
              call "Move To Position.gvi"(Motor Serial Number In=s13, Position to move in mm=w68, Error In=s14) -> (Current Motor Serial nº=w69, Error Out=w70)
              w71 = cluster{"Wavelength": f64[], "Counts": f64[]} {"Wavelength"=[2, 3, 4], "Counts"=[5, 6, 7]}
              Property Node(instance in="Measuring Spot Spectrum Data.gtype" {all zero or empty}, "Beam Spectrum"=w71, "Red Motor Position (mm)"=w68, "Blue Motor Position (mm)"=0) -> (instance out=w72)
              Insert Into Array(inArray=s15, index0=i5, new=w72) -> w73
              next s13 = w69
              next s14 = w70
              next s15 = w73
            }
            call "Disconnect Motor.gvi"(Motor Serial nº=s13, Error In=s14) -> (Error Out=w16)
            Property Node(instance in=w14, "Rainbow Sweep Types"=w13, "Beam Spectrum Data Array"=s15) -> (instance out=w17)
          }
        }
        Insert Into Array(inArray=s1, index0=i1, new=w17) -> w74
        next s1 = w74
        next s2 = w16
        next s3 = w15
      }
      w1 = s1
      w2 = s2
      w3 = s3
    }
  }
  $"Instrument Coms Info Out" <- w3
  $"Error Out" <- w2
  $"Full Beam Multispectral Data Array" <- w1
