vi "MSpot Spectrum Visualizer.gvi"   [LabVIEW NXG 5.0.0]
inputs:
  "Error In": error
  "Full MSpot Multispectral Data Array": "Full MSpot Multispectral Data.gtype"[]
outputs:
  "Error Out": error
panel controls:
  "Sweep Type Selector": i32
  "Graph (position) Selector": i32
  "Continue": bool
panel indicators:
  "Rainbow Sweep Type": "Rainbow Sweep Types.gtype"
  "M Spot Spectrum": cluster{"Element 1": f64[], "Element 2": f64[]}
  "MSpot Spectrum Data": "MSpot Spectrum Data.gtype"
types:
  "Rainbow Sweep Types.gtype" = enum{"Red Sweep Closing", "Red Sweep Opening", "Blue Sweep Closing", "Blue Sweep Opening"}
  "MSpot Spectrum Data.gtype" = cluster{"M Spot Spectrum": cluster{"Wavelength": f64[], "Counts": f64[]}, "Blue Motor Position (mm)": f64, "Red Motor Position (mm)": f64}
  "Full MSpot Multispectral Data.gtype" = cluster{"MSpot Spectrum Data Array": "MSpot Spectrum Data.gtype"[], "Rainbow Sweep Types": "Rainbow Sweep Types.gtype"}
diagram:
  Property Node(instance in=reference to unnamed native front panel, error in=$"Error In") -> ("Window"=w1, error out=w2)
  Open Window(reference in=w1, error in=w2) -> (reference out=w3, error out=w4)
  # This subVI allows us to visualize the data obtained on the Measuring Spot Spectrum Calibration subroutine so that we can
  # extract our own conclusions and elaborate the calibration file.
  case (w4) {
    frame Error, Default {
      w5 = w4
    }
    frame No Error {
      while {
        Array Size(array=$"Full MSpot Multispectral Data Array") -> (size(s)=w6)
        Decrement(x=w6) -> w7
        Property Node(instance in=reference to "Sweep Type Selector", "Maximum"=w7, "Minimum"=0, error in=w4) -> (error out=w8)
        Array Index(array=$"Full MSpot Multispectral Data Array") -> (out0[$"Sweep Type Selector"]=w9)
        Property Node(instance in=w9) -> ("MSpot Spectrum Data Array"=w10, "Rainbow Sweep Types"=w11)
        Array Size(array=w10) -> (size(s)=w12)
        Decrement(x=w12) -> w13
        Property Node(instance in=reference to "Graph (position) Selector", "Minimum"=0, "Maximum"=w13, error in=w8) -> (error out=w5)
        Array Index(array=w10) -> (out0[$"Graph (position) Selector"]=w14)
        $"MSpot Spectrum Data" <- w14
        Property Node(instance in=w14) -> ("M Spot Spectrum"=w15)
        Property Node(instance in=w15) -> ("Wavelength"=w16, "Counts"=w17)
        Build Cluster(w16, w17) -> w18
        $"M Spot Spectrum" <- w18
        Wait Until Next Multiple(multiple to wait=50)
        $"Rainbow Sweep Type" <- w11
        stop if $Continue
      }
    }
  }
  Close Window(reference in=w3, error in=w5) -> (error out=w19)
  $"Error Out" <- w19
