vi "Light Power Calibration Sweep.gvi"   [LabVIEW NXG 5.0.0]
inputs:
  "Error In": error
  "Instrument Coms Info In": "Instrument Coms Info.gtype"
  "Debugging Cluster In": "Debugging Cluster.gtype"
  "Rainbow Sweep Param Selector": "Rainbow Sweep Param Selector.gtype" = {0, 1100, 300, 1, 1, 0}
outputs:
  "Error Out": error
  "Instrument Coms Info Out": "Instrument Coms Info.gtype"
  "Debugging Cluster Out": "Debugging Cluster.gtype"
  "Light Power Calibration Data": "Light Power Calibration Data.gtype"[]
types:
  "Raibow Sweep Selector.gtype" = enum{"Red Sweep", "Blue Sweep", "Full Sweep Red First", "Full Sweep Blue First"}
  T1 = enum{"Red Sweep Closing", "Red Sweep Opening", "Red Sweep Both Ways"}
  T2 = enum{"Blue Sweep Opening", "Blue Sweep Closing", "Blue Sweep Both Ways"}
  "Rainbow Sweep Type Selector.gtype" = cluster{"Red Sweep Mode": T1, "Blue Sweep Mode": T2}
  "Rainbow Sweep Param Selector.gtype" = cluster{"Raibow Sweep Selector": "Raibow Sweep Selector.gtype", "Max Wavelength (nm)": f64, "Min Wavelength (nm)": f64, "Wavelength Step (nm)": f64, "Rainbow Sweep Type Selector": "Rainbow Sweep Type Selector.gtype"}
  "Insturment Debugging Cluster.gtype" = cluster{"Keithley": bool, "Arduinos": bool, "Thorlabs Motors": bool, "Photodetector": bool, "Flame Spectr": bool}
  "Debugging Cluster.gtype" = cluster{"Debugging mode?": bool, "Initialize App": bool, "Insturment Debugging": "Insturment Debugging Cluster.gtype"}
  T3 = cluster{"Element 1": "VISA Instr", "Element 2": string}
  "Arduino Detection cluster control.gtype" = cluster{"XZ Stage Arduino Address": "VISA Instr", "XZ Stage Arduino Detected?": bool, "Multiplexer Arduino Detected?": bool, "Multiplexer Arduino Address": "VISA Instr", "Arduinos List": T3[], "XZ Stage Log": string, "Multiplexer Log": string}
  "Thorlabs Motors Serial Number In.gtype" = cluster{"Thorlabs Blue Motor": string, "Thorlabs Red Motor": string, "Blue Motor Homed?": bool, "Red Motor Homed?": bool}
  "Instrument Coms Info.gtype" = cluster{"Arduino Coms Info": "Arduino Detection cluster control.gtype", "Photodetector Names": string[], "Keythley Address": "VISA Instr", "Photodetector Detected?": bool, "Thorlabs Motors Detected?": bool, "Keithley Detected?": bool, "Thorlabs Motors Serial Number": "Thorlabs Motors Serial Number In.gtype", "Photodetector IVI session": "Ivi IviDefault", "Flame ID": string, "Flame Detected?": bool, "Flame Wrapper ID": u64}
  T4 = cluster{"Dividing Wavelength Array": f64[], "Measured Power Array": f64[]}
  "Rainbow Sweep Types.gtype" = enum{"Red Sweep Closing", "Red Sweep Opening", "Blue Sweep Closing", "Blue Sweep Opening"}
  "Light Power Calibration Data.gtype" = cluster{"Single Light Calibration": T4, "Rainbow Sweep Types": "Rainbow Sweep Types.gtype"}
  "LPC Sweep Live Parameters.gtype" = cluster{"Light Power (W) ": f64, "Current Wavelength (nm)": f64, "Rainbow Sweep Types": "Rainbow Sweep Types.gtype"}
uses:
  Rainbow Measurement Setup::Side Functions::Rainbow Sweep::Rainbow Sweep Param Generator.gvi
  Rainbow Measurement Setup::Side Functions::Instrument Control::Thorlabs Motors::Dividing Wavelength Control::Dividing Wavelength Calibration Data FGV.gvi
  Rainbow Measurement Setup::Side Functions::Instrument Control::Thorlabs Motors::Dividing Wavelength Control::KCube Dividing Wavelength Translator.gvi
  NI::G Core::Numeric::Random Number (Range) DBL.gvi
  Rainbow Measurement Setup::Side Functions::Instrument Control::Photodetector::Photodetector Measure Power.gvi
  Rainbow Measurement Setup::Side Functions::Graphing::Multiple Page Graph Adapter.gvi
  Rainbow Measurement Setup::Main Functions::Rainbow Measurement::Light Power Calibration::Light Calibration Live Parameters FGV.gvi
  Rainbow Measurement Setup::Side Functions::Utilities::Progress Handling::Progress General Calculator.gvi
  Rainbow Measurement Setup::Side Functions::Utilities::Progress Handling::Progress FGV.gvi
diagram:
  case ($"Error In") {
    frame Error, Default {
      w1 = $"Error In"
      w2 = default
      w3 = $"Instrument Coms Info In"
      w4 = $"Debugging Cluster In"
    }
    frame No Error {
      call "Rainbow Sweep Param Generator.gvi"(Rainbow Sweep Parameters=$"Rainbow Sweep Param Selector", Error In=$"Error In") -> (Rainbow Sweep Parameters Array=w5, Error Out=w6)
      call "Dividing Wavelength Calibration Data FGV.gvi"(General FGV Instructions="Read State", Error In=w6) -> (Dividing Wavelength Calibration Data Out=w7, Error Out=w8)
      s1 = w8  # shift register
      s2 = $"Instrument Coms Info In"  # shift register
      s3 = $"Debugging Cluster In"  # shift register
      s4 = "Light Power Calibration Data.gtype"[] []  # shift register
      s5 = f64[][][] []  # shift register
      s6 = 0  # shift register
      for (N -> w9) {
        w10 = each element of w5
        Property Node(instance in=w10) -> ("Dividing Wavelength Array"=w11, "Rainbow Sweep Types"=w12)
        s7 = s2  # shift register
        s8 = s1  # shift register
        s9 = s3  # shift register
        s10 = T4 {all zero or empty}  # shift register
        s11 = f64[][] []  # shift register
        s12 = s6  # shift register
        for (N -> w13) (iteration -> i1) {
          w14 = each element of w11
          Wait Until Next Multiple(multiple to wait=10)
          Property Node(instance in=s10) -> ("Dividing Wavelength Array"=w15, "Measured Power Array"=w16, instance out=w17)
          call "KCube Dividing Wavelength Translator.gvi"(Debugging Cluster=s9, Dividing Wavelength=w14, Instrument Coms Info In=s7, Dividing Wavelength Calibration Data In=w7, Error In=s8, Rainbow Sweep Types=w12) -> (Real Dividing Wavelength=w18, Instrument Coms Info Out=w19, Error Out=w20)
          Insert Into Array(inArray=w15, index0=i1, new=w18) -> w21
          call "Random Number (Range) DBL.gvi"(upper bound=100, lower bound=0) -> (number=w22)
          Insert Into Array(inArray=w16, index0=i1, new=w22) -> w23
          Property Node(instance in=w17, "Dividing Wavelength Array"=w21, "Measured Power Array"=w23) -> (instance out=w24)
          Multiply(w13, w9) -> w25
          Property Node(instance in="LPC Sweep Live Parameters.gtype" {all zero or empty}, "Light Power (W) "=w22, "Current Wavelength (nm)"=w18, "Rainbow Sweep Types"=w12) -> (instance out=w26)
          Build Array(w18, w22) -> w27
          Build Array(s11, w27) -> w28
          Insert Into Array(inArray=s5, new=w28) -> w29
          call "Photodetector Measure Power.gvi"(Instrument Coms Info In=w19, Debugging Cluster In=s9, Error In=w20) -> (Instrument Coms Info Out=w30, Debugging Cluster Out=w31, Error Out=w32)
          call "Multiple Page Graph Adapter.gvi"(Input XY data Multi Page=w29, Error In=w32) -> (Output Multi Graph=w33, Error Out=w34)
          call "Light Calibration Live Parameters FGV.gvi"(FGV Instructions="Set State", Light Calibration Live Parameters In=w26, Light Power Calibration Graph In=w33, Error In=w34) -> (Error Out=w35)
          call "Progress General Calculator.gvi"(Starting Value=40, Ending Value=80, Number Of Steps=w25, Current Step=s12, Error In=w35) -> (Current Progress=w36, Error Out=w37)
          call "Progress FGV.gvi"(FGV Instructions="Set State", Progress In=w36, Error In=w37) -> (Error Out=w38)
          Increment(x=s12) -> w39
          next s7 = w30
          next s8 = w38
          next s9 = w31
          next s10 = w24
          next s11 = w28
          next s12 = w39
        }
        Property Node(instance in="Light Power Calibration Data.gtype" {all zero or empty}, "Single Light Calibration"=s10, "Rainbow Sweep Types"=w12) -> (instance out=w40)
        Insert Into Array(inArray=s4, new=w40) -> w41
        next s1 = s8
        next s2 = s7
        next s3 = s9
        next s4 = w41
        next s5 = w29
        next s6 = s12
      }
      w1 = s1
      w2 = s4
      w3 = s2
      w4 = s3
    }
  }
  $"Debugging Cluster Out" <- w4
  $"Light Power Calibration Data" <- w2
  $"Error Out" <- w1
  $"Instrument Coms Info Out" <- w3
