vi "Main Window.gvi"   [LabVIEW NXG 5.0.0]
panel controls:
  "Main Tab": i32
  "Light Calibration Tab": i32
  "New Spectrum Calibration": bool
  "Load Spectrum Calibration": bool
  "Save Spectrum Calibration": bool
  "Initialize App Bundle Cluster": "Initialize App Bundle Cluster.gtype"
  "Configuration Tab": i32
  "Abort Button": bool
  "Exit App Button": bool
  "Debugging Cluster": "Debugging Cluster.gtype"
  "Rainbow Measurement tab": i32
  "Instrument Coms Info": "Instrument Coms Info.gtype"
  "Rainbow Sweep Param Selector MSpot": "Rainbow Sweep Param Selector.gtype" = {0, 1100, 300, 1, 1, 0}
  "Check Dividing Wavelength Calibration": bool
  "New Dividing Wavelength Calibration": bool
  "Load Dividing Wavelength Calibration": bool
  "Measuring Spot Sperctrum Calibration Parameters": "MSpot Spectrum Calibration Parameters.gtype"
  "New Light Power Calibration": bool
  "Load Light Power Calibration": bool
  "Save Light Power Calibration": bool
  "Rainbow Sweep Parameters LPC": "Rainbow Sweep Param Selector.gtype" = {0, 1100, 300, 1, 1, 0}
  "Default Data Saving Location": path = path "C:\\Users\\minus\\Documents\\LabVIEW Projects\\Rainbow_NXG\\File tests"
  "Light Power Calibration Data": "Light Power Calibration Data.gtype"[]
  "Cell Naming Cluster": "Cell Naming Cluster.gtype"
  "Custom date": bool
  "Author Initials": string
  "Batch Name": string
  "Cell Number": string
  "Sample Comments": string
  "Current Date": string
  "Acquire Single Rainbow Button": bool
  "Load Single Measurement": bool
  "Save Single Measurement": bool
  "Rainbow Sweep Parameters RSM": "Rainbow Sweep Param Selector.gtype" = {0, 1100, 300, 1, 1, 0}
  "LPC Parameters": "Light power Calibration Parameters.gtype" = {"Powermeter Averages"=3}
  "SRM Specific Parameters": "SRM Specific Parameters.gtype" = {"Max (V)"=1.2, "Min (V)"=-0.2, "V Points"=100, "Current Range (A)"=0.1, "Autorange"=TRUE, "Sweep Dir"=FALSE, "Current Averages"=3, "Max (A)"=1, "Integration Time"=0.5, "Cell Area (m^2)"=8e-06}
  "SRM Raw Plot Rainbow Sweep Selector": string
  "SRM Refined Plot Rainbow Sweep Types": string
  "XZ All Position Cluster": "XZ All Position Cluster.gtype"
  "Save Coordinates": bool
  "Main Tab": i32 = 1
  "SRM Plot Parameter Selector": "SRM Refined Plot Parameter Selector.gtype" = "Efficiency (%)"
panel indicators:
  "Irradiance Calibration": f64[]
  "Current State": "Queue Instructions Control.gtype"
  "Current Sub State": string
  "Beam Power Density": f64[][]
  "Path Where the Calibration Files Will Be Stored (Can't Be Changed)": path
  "Desired MSpot Calibration Operation": "Calibration Operation Control.gtype"
  "Light Power Calibration": cluster{"Wavelength": f64[], "Power": f64[]}[]
  "Sample Prefix": string
  "Progress %": f64
  "Progress counter": f64
  "State": string
  "Substate": string
  "Label Info Error Label": string
  "Label Info Missing Error": bool
  "IV Plot Out": "SRM Single Plot Cluster.gtype"[]
  "FulL IV data Cluster": "IV Full Data Cluster.gtype"[]
  "IV Extracted Parameter Plot": T4
  "Sweep Live Parameters LPC": "LPC Sweep Live Parameters.gtype"
  "Sweep Live Parameters RSM": "SRM Sweep Live Parameters.gtype"
types:
  "All Paths Cluster.gtype" = cluster{"Thorlabs Motor Serial Number File Path": path}
  "Instrument Coms Info.gtype" = cluster{"Arduino Coms Info": "Arduino Detection cluster control.gtype", "Photodetector Names": string[], "Keythley Address": "VISA Instr", "Photodetector Detected?": bool, "Thorlabs Motors Detected?": bool, "Keithley Detected?": bool, "Thorlabs Motors Serial Number": "Thorlabs Motors Serial Number In.gtype", "Photodetector IVI session": "Ivi IviDefault", "Flame ID": string, "Flame Detected?": bool, "Flame Wrapper ID": u64}
  "Debugging Cluster.gtype" = cluster{"Debugging mode?": bool, "Initialize App": bool, "Insturment Debugging": "Insturment Debugging Cluster.gtype"}
  "Initialize App Bundle Cluster.gtype" = cluster{"All Paths": "All Paths Cluster.gtype", "Instrument Coms Info": "Instrument Coms Info.gtype", "Debugging Cluster": "Debugging Cluster.gtype"}
  "Queue Instructions Control.gtype" = enum{"Undefined State", "Debug Check", "Initialize App", "Idle", "Light Power Calibration", "Rainbow Single Measurement", "Light Calibration Irradiance", "Light Calibration Spectral Density", "Light Calibration Power Density", "MSpot Spectrum Calibration", "Access TXT File", "Stop App"}
  "Raibow Sweep Selector.gtype" = enum{"Red Sweep", "Blue Sweep", "Full Sweep Red First", "Full Sweep Blue First"}
  T1 = enum{"Red Sweep Closing", "Red Sweep Opening", "Red Sweep Both Ways"}
  T2 = enum{"Blue Sweep Opening", "Blue Sweep Closing", "Blue Sweep Both Ways"}
  "Rainbow Sweep Type Selector.gtype" = cluster{"Red Sweep Mode": T1, "Blue Sweep Mode": T2}
  "Rainbow Sweep Param Selector.gtype" = cluster{"Raibow Sweep Selector": "Raibow Sweep Selector.gtype", "Max Wavelength (nm)": f64, "Min Wavelength (nm)": f64, "Wavelength Step (nm)": f64, "Rainbow Sweep Type Selector": "Rainbow Sweep Type Selector.gtype"}
  "Calibration Operation Control.gtype" = enum{"Check Calibration", "Load Calibration", "New Calibration"}
  "MSpot Spectrum Calibration Parameters.gtype" = cluster{"Min Position (mm)": f64, "Max Position (mm)": f64, "Position step size (mm)": f64, "Manual Spectra?": bool, "Flame Integration Time (us)": f64, "Flame Scans to Average": u32}
  T3 = cluster{"Dividing Wavelength Array": f64[], "Measured Power Array": f64[]}
  "Rainbow Sweep Types.gtype" = enum{"Red Sweep Closing", "Red Sweep Opening", "Blue Sweep Closing", "Blue Sweep Opening"}
  "Light Power Calibration Data.gtype" = cluster{"Single Light Calibration": T3, "Rainbow Sweep Types": "Rainbow Sweep Types.gtype"}
  "Cell Naming Cluster.gtype" = cluster{"Cell Label": string, "Sample Prefix": string, "Author Initials": string, "Current Date": string, "Batch Name": string}
  "SRM Single Plot Cluster.gtype" = cluster{"Voltage": f64[], "Current Density": f64[]}
  "Light power Calibration Parameters.gtype" = cluster{"Powermeter Averages": f64}
  "SRM Specific Parameters.gtype" = cluster{"Max (V)": f64, "Min (V)": f64, "V Points": u32, "Current Range (A)": f64, "Autorange": bool, "Sweep Dir": bool, "Current Averages": u32, "Max (A)": f64, "Integration Time": f64, "Cell Area (m^2)": f64}
  "IV Single Measurement.gtype" = cluster{"Voltage": f64[], "Current": f64[], "Current Density": f64[], "Dividing Wavelength": f64, "Light Power": f64}
  "IV Refined Full Sweep Data.gtype" = cluster{"Rs (Ω/m^2)": f64[], "Rsh (Ω/m^2)": f64[], "Jsc (A/m^2)": f64[], "Voc (V)": f64[], "FF (%)": f64[], "Efficiency (%)": f64[], "Dividing Wavelength (nm)": f64[], "Light Power (W)": f64[]}
  "IV Full Data Cluster.gtype" = cluster{"IV Measurements Array": "IV Single Measurement.gtype"[], "Rainbow Sweep Types": "Rainbow Sweep Types.gtype", "IV Refined Data": "IV Refined Full Sweep Data.gtype"}
  T4 = cluster{"Dividing Wavelength (nm)": f64[], "Element 2": f64[]}
  T5 = cluster{"X Coordinate (mm)": f64, "Z Coordinate (mm)": f64}
  "XZ All Position Cluster.gtype" = cluster{"Cell R.01 Coordinates": T5, "Diffusor Coordinates": T5, "Photodetector Coordinates": T5}
  "LPC Sweep Live Parameters.gtype" = cluster{"Light Power (W) ": f64, "Current Wavelength (nm)": f64, "Rainbow Sweep Types": "Rainbow Sweep Types.gtype"}
  "SRM Sweep Live Parameters.gtype" = cluster{"Current Wavelength (nm)": f64, "Rainbow Sweep Types": "Rainbow Sweep Types.gtype", "Finished Measurement?": bool}
  "SRM Refined Plot Parameter Selector.gtype" = enum{"Efficiency (%)", "Jsc (A)", "Voc (V)", "Light Power (W)", "FF (%)", "Rs (Ω/m^2)", "Rsh (Ω/m^2)"}
  "IV Full Raw Data.gtype" = cluster{"Rainbow Sweep Types": "Rainbow Sweep Types.gtype", "IV Raw Data Array": "IV Single Measurement.gtype"[]}
  "SRM Sweep Live Parameters FGV Cluster.gtype" = cluster{"IV Single Measurement Array": "IV Single Measurement.gtype"[], "SRM Sweep type combo box selction": string, "IV Single Measurement Plot Array": "SRM Single Plot Cluster.gtype"[], "SRM Live Parameters": "SRM Sweep Live Parameters.gtype", "Counter": i32, "Full IV Data Array": "IV Full Raw Data.gtype"[], "Combobox Reference": "ComboBoxSelector reference", "Refresh now": bool, "Graph Reference": "Graph reference"}
  "Sample Naming Cluster.gtype" = cluster{"Author Initials": string, "Batch Name": string, "Sample Comments": string, "Main Tab control": i32, "Rainbow Measurement tab": i32, "Cell Number": string, "Cell Number ref": "StringControl reference", "Custom date": bool, "Current Date": string, "Current Date ref": "StringControl reference"}
uses:
  Rainbow Measurement Setup::Side Functions::Global Abort::FGV Global Abort.gvi
  Rainbow Measurement Setup::Main Functions::Instruction Queue::Current State::FGV Current State.gvi
  Rainbow Measurement Setup::Main Functions::Debugging::Debugging Prompt.gvi
  Rainbow Measurement Setup::Main Functions::Initialize App::Initialize app subroutine.gvi
  Rainbow Measurement Setup::Side Functions::Utilities::Progress Handling::Progress FGV.gvi
  Rainbow Measurement Setup::Main Functions::One Time Calibrations::MSpot Spectrum::File Handling::MSpot Folder Check.gvi
  Rainbow Measurement Setup::Main Functions::One Time Calibrations::MSpot Spectrum::MSpot Spectrum Calibration Subroutine.gvi
  Rainbow Measurement Setup::Main Functions::Rainbow Measurement::Light Power Calibration::Light Power Calibration Subroutine.gvi
  Rainbow Measurement Setup::Main Functions::Rainbow Measurement::Cell Single Rainbow Measurement::Single Rainbow Measurement Subroutine.gvi
  NI::G Core::Error::Is Error.gvi
  Rainbow Measurement Setup::Side Functions::Global Abort::Global Abort Sequence.gvi
  Rainbow Measurement Setup::Main Functions::Rainbow Measurement::Cell Single Rainbow Measurement::SRM Sweep Live Parameters FGV.gvi
  Rainbow Measurement Setup::Main Functions::Rainbow Measurement::Cell Single Rainbow Measurement::Plotting::SRM Sweep Refined Data FGV.gvi
  Rainbow Measurement Setup::Main Functions::Rainbow Measurement::Light Power Calibration::Light Calibration Live Parameters FGV.gvi
  Rainbow Measurement Setup::Side Functions::Timeout Sequence.gvi
  Rainbow Measurement Setup::Side Functions::Exit App Sequence.gvi
  Rainbow Measurement Setup::Main Functions::Instruction Queue::Check Queue And Label.gvi
  Rainbow Measurement Setup::Main Functions::Instruction Queue::Conditional Enqueue.gvi
  Rainbow Measurement Setup::Main Functions::One Time Calibrations::MSpot Spectrum::MSpot Calibration Operation Translator.gvi
  Rainbow Measurement Setup::Side Functions::Sample Naming::Sample Name Checkup Subroutine.gvi
  Rainbow Measurement Setup::Side Functions::Sample Naming::Sample Prefix FGV.gvi
  Rainbow Measurement Setup::Main Functions::Rainbow Measurement::Light Power Calibration::Light Power Calibration Operation Translator.gvi
  Rainbow Measurement Setup::Main Functions::Rainbow Measurement::Cell Rainbow Single Measurement::SRM Operation Translator.gvi
  NI::G Core::Error::Multiplex Errors.gvi
  NI::G Core::Error::Display Error.gvi
  Rainbow Measurement Setup::Main Functions::Initialize App::Restart Controls Cluster.gvi
  Rainbow Measurement Setup::Function_3.gvi
diagram:
  call "FGV Global Abort.gvi"(Global Abort Instructions="Reset State") -> (Error Out=w1)
  call "FGV Current State.gvi"(Current State Instructions="Set Current State and Substate", Current State="Undefined State", Current Substate="Starting Up", Error In=w1) -> (Error Out=w2)
  Obtain Queue(create if not found=TRUE, element data type="Queue Instructions Control.gtype" "Undefined State", error in=w2, name="Instruction Queue") -> (error out=w3, queue out=w4)
  Enqueue Element(element="Debug Check", error in=w3, queue=w4) -> (error out=w5, queue out=w6)
  s1 = w6  # shift register
  s2 = w5  # shift register
  while {
    # This is the consumer loop, it takes enqueued instructions and performs the ne required actions
    case (s2) {
      frame Error, Default {
        w7 = s2
        w8 = s1
        w9 = TRUE
      }
      frame No Error {
        Dequeue Element(error in=s2, queue=s1) -> (element=w10, error out=w11, queue out=w12)
        case (w10) {
          frame "Undefined State" {
            w7 = w11
            w8 = w12
            w9 = default
          }
          frame "Debug Check" {
            call "Debugging Prompt.gvi"(Debugging Cluster In=$"Debugging Cluster", Error In=w11) -> (Debugging Cluster Out=w13, Error Out=w14)
            Enqueue Element(element="Initialize App", error in=w14, queue=w12) -> (error out=w7, queue out=w8)
            $"Debugging Cluster" <- w13
            w9 = default
          }
          frame "Initialize App" {
            Property Node(instance in=$"Initialize App Bundle Cluster", "Debugging Cluster"=$"Debugging Cluster") -> (instance out=w15)
            call "Initialize app subroutine.gvi"(Initialize App Bundle Cluster In=w15, Error In=w11) -> (Initialize App Bundle Cluster Out=w16, Error Out=w17)
            Property Node(instance in=w16) -> ("Instrument Coms Info"=w18, "Debugging Cluster"=w19)
            $"Instrument Coms Info" <- w18
            $"Initialize App Bundle Cluster" <- w16
            Enqueue Element(element="Idle", error in=w17, queue=w12) -> (error out=w7, queue out=w8)
            $"Debugging Cluster" <- w19
            w9 = default
          }
          frame "Idle", Default {
            call "FGV Global Abort.gvi"(Global Abort Instructions="Reset State", Error In=w11) -> (Error Out=w20)
            call "FGV Current State.gvi"(Current State Instructions="Set Current State and Substate", Current State="Idle", Current Substate="Idle", Error In=w20) -> (Error Out=w21)
            call "Progress FGV.gvi"(FGV Instructions="Reset State", Error In=w21) -> (Error Out=w7)
            w8 = w12
            w9 = default
          }
          frame "MSpot Spectrum Calibration" {
            call "MSpot Folder Check.gvi"(Error In=w11) -> (Error Out=w22, Calibration Files Folder=w23)
            $"Path Where the Calibration Files Will Be Stored (Can't Be Changed)" <- w23
            call "MSpot Spectrum Calibration Subroutine.gvi"(Instrument Coms Info In=$"Instrument Coms Info", Rainbow Sweep Param Selector=$"Rainbow Sweep Param Selector MSpot", MSpot Spectrum Calibration Parameters In=$"Measuring Spot Sperctrum Calibration Parameters", Debugging Cluster In=$"Debugging Cluster", Error In=w22, Stand Alone?=FALSE, Calibration Operation Control=$"Desired MSpot Calibration Operation") -> (Instrument Coms Info Out=w24, Debugging Cluster Out=w25, Error Out=w26)
            $"Instrument Coms Info" <- w24
            $"Debugging Cluster" <- w25
            Enqueue Element(element="Idle", error in=w26, queue=w12) -> (error out=w7, queue out=w8)
            w9 = default
          }
          frame "Light Power Calibration" {
            call "Light Power Calibration Subroutine.gvi"(Instrument Coms Info In=$"Instrument Coms Info", Debugging Cluster In=$"Debugging Cluster", Rainbow Sweep Param Selector=$"Rainbow Sweep Parameters LPC", Light Power Calibration Data In=$"Light Power Calibration Data", Cell Naming Cluster=$"Cell Naming Cluster", Error In=w11, Default Data Saving Location=$"Default Data Saving Location", Stand Alone?=FALSE) -> (Instuments Coms Info Out=w27, Debugging Cluster Out=w28, Light Power Calibration Data Out=w29, Error Out=w30)
            $"Instrument Coms Info" <- w27
            $"Debugging Cluster" <- w28
            Enqueue Element(element="Idle", error in=w30, queue=w12) -> (error out=w7, queue out=w8)
            $"Light Power Calibration Data" <- w29
            w9 = default
          }
          frame "Rainbow Single Measurement" {
            call "Single Rainbow Measurement Subroutine.gvi"(Instrument Coms Info In=$"Instrument Coms Info", Debugging Cluster In=$"Debugging Cluster", Light Power Calibration Data=$"Light Power Calibration Data", Instruction Queue In=w12, Default Data Saving Location=$"Default Data Saving Location", Cell Naming Cluster=$"Cell Naming Cluster", Rainbow Sweep Param Selector=$"Rainbow Sweep Parameters RSM", SRM Specific Parameters=$"SRM Specific Parameters", Error In=w11, Stand Alone?=FALSE, Rainbow Tab Reference=reference to "Rainbow Measurement tab") -> (Instuments Coms Info Out=w31, Debugging Cluster Out=w32, Instruction Queue Out=w33, FulL IV data Cluster=w34, SRM Rainbow Parameters=w35, Error Out=w36)
            $"Debugging Cluster" <- w32
            $"Instrument Coms Info" <- w31
            Enqueue Element(element="Idle", error in=w36, queue=w33) -> (error out=w7, queue out=w8)
            $"FulL IV data Cluster" <- w34
            $"Rainbow Sweep Parameters LPC" <- w35
            w9 = default
          }
          frame "Stop App" {
            call "FGV Current State.gvi"(Current State Instructions="Set Current State and Substate", Current State="Stop App", Current Substate="Bye Bye :D", Error In=w11) -> (Error Out=w7)
            w8 = w12
            w9 = TRUE
          }
        }
      }
    }
    call "Is Error.gvi"(error in=w7) -> (error?=w37)
    Logical Or(w37, w9) -> w38
    call "FGV Global Abort.gvi"(Global Abort Instructions="Set State", Global Abort=w38, Error In=w7) -> (Error Out=w39)
    next s1 = w8
    next s2 = w39
    stop if w38
  }
  s3 = w6  # shift register
  s4 = w5  # shift register
  while {
    event (timeout = 100) {
      on "Timeout" {
        call "FGV Global Abort.gvi"(Global Abort Instructions="Read Current State", Error In=s4) -> (Global Abort Out=w43, Error Out=w44)
        Preview Queue Element(error in=w44, queue=s3, timeout in ms=100) -> (element=w45, error out=w40, queue out=w41)
        Is Equal(x=w45, y="Stop App") -> w46
        Logical Or(w46, w43) -> w42
      }
      on "Abort Button" Value changed {
        call "Global Abort Sequence.gvi"(Queue In=s3, Global Abort=$"Abort Button", Error In=s4) -> (Queue Out=w41, Error Out=w40)
        w42 = default
      }
    }
    next s3 = w41
    next s4 = w40
    stop if w42
  }
  Enqueue Element(element="Stop App", error in=s4, queue=s3) -> (error out=w47)
  # This is the main window it takes instructions from the main pannel introduced by the user and
  # performs the corresponding necessary actions
  s5 = w6  # shift register
  s6 = w5  # shift register
  while {
    # This is the producer loop that takes the commands and if possible enqueues them so that the
    # slave loop can perform the corresponding actions
    event (timeout = 100) {
      on "Timeout" {
        w51 = "SRM Sweep Live Parameters FGV Cluster.gtype" {all zero or empty}
        Property Node(instance in=w51, "Combobox Reference"=reference to "SRM Raw Plot Rainbow Sweep Selector", "Graph Reference"=reference to "IV Plot Out") -> (instance out=w52)
        call "SRM Sweep Live Parameters FGV.gvi"(FGV Instructions="Read State", SRM sweep live parameters FGV Cluster In=w52, Error In=s6) -> (SRM Live Parameters=w53, IV Plot Out=w54, Error Out=w55)
        call "SRM Sweep Refined Data FGV.gvi"(Parameter Selector=$"SRM Plot Parameter Selector", SRM Refined Plot Rainbow Sweep Types Selector=reference to "SRM Refined Plot Rainbow Sweep Types", Error In=w55, FGV Instructions="Read State") -> (IV Extracted Parameters Plot=w56, Error Out=w57)
        call "Light Calibration Live Parameters FGV.gvi"(FGV Instructions="Read State", Error In=w57, Set Names=TRUE, Graph Reference In=reference to "Light Power Calibration") -> (Light Calibration Parameters Out=w58, Light Power Calibration Graph Out=w59, Error Out=w60)
        call "Progress FGV.gvi"(FGV Instructions="Read State", Error In=w60) -> (Progress Out=w61, Error Out=w62)
        $"Progress %" <- w61
        $"Progress counter" <- w61
        call "Timeout Sequence.gvi"(Queue In=s5, Error In=w62) -> (Stop App?=w50, Queue Out=w48, Current State Out=w63, Current SubState Out=w64, Error Out=w65)
        $"Current State" <- w63
        $Substate <- w64
        $"Current Sub State" <- w64
        $"Sweep Live Parameters RSM" <- w53
        Format Into String(errIn=w65, w63) -> (outString=w66, errOut=w49)
        $State <- w66
        $"IV Plot Out" <- w54
        $"IV Extracted Parameter Plot" <- w56
        $"Sweep Live Parameters LPC" <- w58
        $"Light Power Calibration" <- w59
      }
      on "Exit App Button" Value changed {
        call "Exit App Sequence.gvi"(Queue In=s5, Exit App=$"Exit App Button", Error In=s6) -> (Queue Out=w48, Error Out=w49)
        w50 = default
      }
      on "Check Dividing Wavelength Calibration" Value changed; "Load Dividing Wavelength Calibration" Value changed; "New Dividing Wavelength Calibration" Value changed {
        call "Check Queue And Label.gvi"(Error In=s6) -> (Proceed to enqueue=w67, Error Out=w68)
        call "Conditional Enqueue.gvi"(Queue In=s5, Queue Instruction In="MSpot Spectrum Calibration", Error Out=w68, Equeue?=w67) -> (Queue Out=w48, Error In=w69)
        call "MSpot Calibration Operation Translator.gvi"(Check Dividing Wavelength Calibration=$"Check Dividing Wavelength Calibration", New Dividing Wavelength Calibration=$"New Dividing Wavelength Calibration", Load Dividing Wavelength Calibration=$"Load Dividing Wavelength Calibration", Error In=w69) -> (Desired Operation=w70, Error Out=w49)
        $"Desired MSpot Calibration Operation" <- w70
        w50 = default
      }
      on "Author Initials" Value changed; "Batch Name" Value changed; "Cell Number" Value changed; "Current Date" Value changed; "Custom date" Value changed; "Main Tab" Value changed; "Rainbow Measurement tab" Value changed; "Sample Comments" Value changed; "Sample Prefix" Value changed {
        Property Node(instance in="Sample Naming Cluster.gtype" {all zero or empty}, "Author Initials"=$"Author Initials", "Batch Name"=$"Batch Name", "Sample Comments"=$"Sample Comments", "Main Tab control"=$"Main Tab", "Rainbow Measurement tab"=$"Rainbow Measurement tab", "Cell Number"=$"Cell Number", "Cell Number ref"=reference to "Cell Number", "Custom date"=$"Custom date", "Current Date"=$"Current Date", "Current Date ref"=reference to "Current Date") -> (instance out=w71)
        call "Sample Name Checkup Subroutine.gvi"(Sample Naming Cluster=w71, Error In=s6) -> (Current Date=w72, Sample Prefix=w73, Label Info Error Label=w74, Label Info Missing Error=w75, Error Out=w76, Cell Naming Cluster=w77)
        $"Cell Naming Cluster" <- w77
        $"Sample Prefix" <- w73
        $"Label Info Error Label" <- w74
        call "Sample Prefix FGV.gvi"(FGV Instructions="Set State", Sample Prefix In=w73, Error In=w76) -> (Error Out=w49)
        $"Label Info Missing Error" <- w75
        $"Current Date" <- w72
        w48 = s5
        w50 = default
      }
      on "Load Light Power Calibration" Value changed; "New Light Power Calibration" Value changed; "Save Light Power Calibration" Value changed {
        call "Check Queue And Label.gvi"(Label Info Missing Error=$"Label Info Missing Error", Label Info Error Label=$"Label Info Error Label", Error In=s6, Is Label Necessary?=TRUE) -> (Proceed to enqueue=w78, Error Out=w79)
        call "Conditional Enqueue.gvi"(Queue In=s5, Queue Instruction In="Light Power Calibration", Error Out=w79, Equeue?=w78) -> (Queue Out=w48, Error In=w80)
        call "Light Power Calibration Operation Translator.gvi"(New Light Power Calibration=$"New Light Power Calibration", Load Light Power Calibration=$"Load Light Power Calibration", Save Light Power Calibration=$"Save Light Power Calibration", Error In=w80) -> (Error Out=w49)
        w50 = default
      }
      on "Acquire Single Rainbow Button" Value changed; "Load Single Measurement" Value changed; "Save Single Measurement" Value changed {
        call "Check Queue And Label.gvi"(Label Info Missing Error=$"Label Info Missing Error", Label Info Error Label=$"Label Info Error Label", Error In=s6, Is Label Necessary?=TRUE) -> (Proceed to enqueue=w81, Error Out=w82)
        call "Conditional Enqueue.gvi"(Queue In=s5, Queue Instruction In="Rainbow Single Measurement", Error Out=w82, Equeue?=w81) -> (Queue Out=w48, Error In=w83)
        call "SRM Operation Translator.gvi"(Acquire Single Rainbow Button=$"Acquire Single Rainbow Button", Load Single Measurement=$"Load Single Measurement", Save Single Measurement=$"Save Single Measurement", Error In=w83) -> (Error Out=w49)
        w50 = default
      }
    }
    Logical Or(w49, w50) -> w84
    next s5 = w48
    next s6 = w49
    stop if w84
  }
  Enqueue Element(element="Stop App", error in=s6, queue=s5) -> (error out=w85)
  call "Multiplex Errors.gvi"(error in 1=w85, error in 2=s2, error in 3=w47) -> (error out=w86)
  Flush Queue(error in=w86, queue=s1) -> (error out=w87, queue out=w88)
  Release Queue(error in=w87, queue=w88) -> (error out=w89)
  case (w89) {
    frame Error, Default {
      # In case there is an error
      # put out an error handler
      call "Display Error.gvi"(error in=w89)
    }
    frame No Error { }
  }
  call "Restart Controls Cluster.gvi"(Custom Date Reference=reference to "Custom date", Author Initials Reference=reference to "Author Initials", Batch Name Reference=reference to "Batch Name", Main Tab Reference=reference to "Main Tab", Cell Number Reference=reference to "Cell Number", Rainbow Measurement Tab Reference=reference to "Rainbow Measurement tab", Sample Comments Reference=reference to "Sample Comments", Label Info Missing Error Reference=reference to "Label Info Missing Error", Beam Power Density Reference=reference to "Beam Power Density", Irradiance Calibration Reference=reference to "Irradiance Calibration", Configuration Tab Reference=reference to "Configuration Tab", Light Calibration Tab Reference=reference to "Light Calibration Tab", XZ All Position Cluster Reference=reference to "XZ All Position Cluster", SRM Refined Plot Rainbow Sweep Types Reference=reference to "SRM Refined Plot Rainbow Sweep Types")
  w90 = reference to "Path Where the Calibration Files Will Be Stored (Can't Be Changed)"
  w91 = reference to "Measuring Spot Sperctrum Calibration Parameters"
  call "Function_3.gvi"(1=reference to "SRM Plot Parameter Selector", 2=reference to "Label Info Error Label", 3=reference to "Default Data Saving Location", 4=reference to "Light Power Calibration Data", 5=reference to "Light Power Calibration", 6=reference to "LPC Parameters", 7=w91, 8=w90, 9=reference to "Rainbow Sweep Param Selector MSpot", 10=reference to "Rainbow Sweep Parameters RSM", 11=reference to "SRM Plot Parameter Selector", 12=reference to "SRM Raw Plot Rainbow Sweep Selector", 13=reference to "SRM Refined Plot Rainbow Sweep Types", 14=reference to "SRM Specific Parameters", 15=reference to "Sweep Live Parameters LPC", 16=reference to "Sweep Live Parameters RSM", 17=reference to "XZ All Position Cluster")
